# Grasshopper definition Tunnel_Generation.gh (Grasshopper 1.0.8)
# plug-ins: Speckle 2, Pancake, eleFront

panel = Panel("https://app.speckle.systems/projects/b74089b7cc/models/daa7d544aa")
panel_2 = Panel("D:\xuexi\24-25SRP\Github\TunCO2\Grasshopper-Power-BI Stream")
concat = Concatenate(FragmentA=panel_2, FragmentB="\pbi_export.csv")

panel_3 = Panel("Import Data")
file = ReadFile(File=concat, PerLineParse=True)
item = ListItem(List=file, Index="1", Wrap=True)
panel_4 = Panel(item)
split = TextSplit(Text=panel_4, Separators=",")
item_2 = ListItem(List=split, Index="0", Wrap=True)
item_3 = ListItem(List=split, Index="1", Wrap=True)
item_4 = ListItem(List=split, Index="2", Wrap=True)
item_5 = ListItem(List=split, Index="3", Wrap=True)
item_6 = ListItem(List=split, Index="4", Wrap=True)
item_7 = ListItem(List=split, Index="5", Wrap=True)
num = Number(item_5)
num_2 = Number(item_2)
num_3 = Number(item_3)
num_4 = Number(item_7)
num_5 = Number(item_6)

concat_2 = Concatenate(FragmentA=panel_2, FragmentB="\book1.csv")

# ----
# Create and Bake Segmented Ring
series = Series(Start=1, Step=1, Count=num_2)
expression = Expression(Expression="Format(\"2*2*π/y-x*π/180\", x, y)")
expression_2 = Expression(Expression="Format(\"2*π/y+x*π/180\", x, y)")
expression_3 = Expression(Expression="Format(\"x*2*π/y\", x, y)")
pt = Point("0,0,0")
lng = ListLength(List=series)
line = LineSDL(Start=pt, Direction=Vector(0, 0, 1), Length=num_4)
eval = Evaluate(F=expression_3, x=series, y=lng)
eval_2 = Evaluate(F=expression_2, x=num, y=lng)
eval_3 = Evaluate(F=expression, x=num, y=lng)
end = EndPoints(Curve=line)  # -> Start, End
replace = ReplaceItems(List=eval, Item=eval_2, Indices=0, Wrap=False)
shift = ShiftList(List=eval, Shift=-1, Wrap=True)
replace_2 = ReplaceItems(List=replace, Item=eval_3, Indices=1, Wrap=False)
shift_2 = ShiftList(List=replace_2, Shift=-1, Wrap=True)
replace_3 = ReplaceItems(List=shift, Item=0, Indices=0, Wrap=False)
dom = ConstructDomain(DomainStart=replace_3, DomainEnd=eval)
replace_4 = ReplaceItems(List=shift_2, Item=0, Indices=0, Wrap=False)
dom_2 = ConstructDomain(DomainStart=replace_4, DomainEnd=replace_2)
arc = Arc(Plane=end.Start, Radius=num_3, Angle=dom)  # -> Arc, Length
arc_2 = Arc(Plane=end.End, Radius=num_3, Angle=dom_2)  # -> Arc, Length
offset = OffsetCurve(Curve=arc.Arc, Distance=num_5, Corners=1)  # -> flatten(Curve)
offset_2 = OffsetCurve(Curve=arc_2.Arc, Distance=num_5, Corners=1)  # -> flatten(Curve)
end_2 = EndPoints(Curve=offset_2)  # -> Start, End
end_3 = EndPoints(Curve=arc_2.Arc)  # -> Start, End
end_4 = EndPoints(Curve=offset)  # -> Start, End
end_5 = EndPoints(Curve=arc.Arc)  # -> Start, End
ln = Line(StartPoint=end_2.Start, EndPoint=end_3.Start)
ln_2 = Line(StartPoint=end_4.Start, EndPoint=end_5.Start)
rulesrf = RuledSurface(CurveA=arc.Arc, CurveB=offset)
rulesrf_2 = RuledSurface(CurveA=arc_2.Arc, CurveB=offset_2)
rulesrf_3 = RuledSurface(CurveA=offset, CurveB=offset_2)
rulesrf_4 = RuledSurface(CurveA=arc.Arc, CurveB=arc_2.Arc)
rulesrf_5 = RuledSurface(CurveA=ln_2, CurveB=ln)
shift_3 = ShiftList(List=rulesrf_5, Shift=1, Wrap=True)
entwine = Entwine(
    Branch00=rulesrf_5,
    Branch01=shift_3,
    Branch02=rulesrf,
    Branch03=rulesrf_2,
    Branch04=rulesrf_3,
    Branch05=rulesrf_4,
    FlattenInputs=True)
flip = FlipMatrix(Data=entwine)
bvol = BoundaryVolume(Boundaries=flip)
bake = BakeObjects(Geometry=bvol, Bake=False, createGroups=False)  # -> Message, Guids; disabled

cir = Circle(Plane=end.End, Radius=num_3)
circle = CircleCNR(Center=pt, Normal=line, Radius=num_3)
offset_3 = OffsetCurve(Curve=cir, Distance=num_5, Corners=1)
offset_4 = OffsetCurve(Curve=circle, Distance=num_5, Corners=1)
python = GhPythonScript(x=num_2)  # -> out, a
# ---------- python: Python ----------
__author__ = "fxia0007"
__version__ = "2023.12.29"

import rhinoscriptsyntax as rs

if (x % 2) == 0: 
    a = x /2
else:
    a = (x-1)/2
# ---------- end python ----------
rulesrf_6 = RuledSurface(CurveA=circle, CurveB=offset_4)
rulesrf_7 = RuledSurface(CurveA=cir, CurveB=circle)
rulesrf_8 = RuledSurface(CurveA=offset_4, CurveB=offset_3)
rulesrf_9 = RuledSurface(CurveA=cir, CurveB=offset_3)
entwine_2 = Entwine(Branch00=rulesrf_6, Branch01=rulesrf_9, Branch02=rulesrf_7, Branch03=rulesrf_8, FlattenInputs=True)
planar = IsPlanar(Surface=rulesrf_6, Interior=True)  # -> Planar, Plane
planar_2 = IsPlanar(Surface=rulesrf_9, Interior=True)  # -> Planar, Plane
flip_2 = FlipMatrix(Data=entwine_2)
expression_4 = Expression(Expression="Format(\"x*2*π*(1-z/180)/y\", x, y,z)")
series_2 = Series(Start=0, Step=1, Count=num_2)
rotate = Rotate(Geometry=planar_2.Plane, Angle=0.9424777961, Plane=planar_2.Plane)  # -> Geometry, Transform
rotate_2 = Rotate(Geometry=planar.Plane, Angle=0.9424777961, Plane=planar.Plane)  # -> Geometry, Transform
bvol_2 = BoundaryVolume(Boundaries=flip_2)

# ----
# Create and Bake Lining
crv = Curve(<curve referenced from the Rhino model>)
path = FilePath(concat_2)
len = Length(Curve=crv)
division = Division(A=len, B=num_4)
file_2 = ReadFile(File=path, PerLineParse=True)
expression_5 = Expression(Expression="Format(\"x-1\", x)")
divide = DivideCurve(Curve=crv, Count=division, Kinks=False)  # -> Points, Tangents, Parameters
shatter = Shatter(Curve=crv, Parameters=divide.Parameters)
eval_4 = Evaluate(F=expression_5, x=division)
subset = SubList(List=file_2, Domain=eval_4, Wrap=True)  # -> graft(List), Index
flow = Flow(Geometry=bvol_2, Base=line, Target=shatter, ReverseBase=False, ReverseTarget=False, Stretch=True, Rigid=False)
rot3d = Rotate3D(Geometry=bvol, Angle=subset.List, Center=end.Start, Axis=line)  # -> Geometry, Transform
bake_2 = BakeObjects(Geometry=flow, Bake=False, createGroups=False)  # -> Message, Guids; disabled

entwine_3 = Entwine(
    Branch00=subset.List,
    Branch01=subset.List,
    Branch02=subset.List,
    Branch03=subset.List,
    Branch04=subset.List,
    Branch05=subset.List,
    FlattenInputs=True)
item_8 = ListItem(List=flow, Index=0, Wrap=True)
flip_3 = FlipMatrix(Data=entwine_3)
debrep = DeconstructBrep(Brep=flow)  # -> Faces, Edges, Vertices
item_9 = ListItem(List=debrep.Faces, Index=1, Wrap=True)
item_10 = ListItem(List=debrep.Faces, Index=0, Wrap=True)
planar_3 = IsPlanar(Surface=item_9, Interior=True)  # -> Planar, Plane
planar_4 = IsPlanar(Surface=item_10, Interior=True)  # -> Planar, Plane
lng_2 = ListLength(List=series_2)
deplane = DeconstructPlane(Plane=planar_3.Plane)  # -> Origin, XAxis, YAxis, ZAxis
addition = Addition(A=num_3, B=num_5)
deplane_2 = DeconstructPlane(Plane=planar_4.Plane)  # -> Origin, XAxis, YAxis, ZAxis
addition_2 = Addition(A=num_3, B=num_5)
expression_6 = Expression(Expression="Format(\"x-y*π/180\", x,y)")
expression_7 = Expression(Expression="Format(\"x+y*π/180\", x,y)")
eval_5 = Evaluate(F=expression_4, x=series_2, y=lng_2, z=num)
split_2 = SplitList(List=eval_5, Index=python.a)  # -> ListA, ListB
line_2 = LineSDL(Start=deplane.Origin, Direction=deplane.XAxis, Length=addition)
edges = BrepEdges(Brep=item_9)  # -> Naked, Interior, NonManifold
edges_2 = BrepEdges(Brep=item_10)  # -> Naked, Interior, NonManifold
line_3 = LineSDL(Start=deplane_2.Origin, Direction=deplane_2.XAxis, Length=addition_2)
item_11 = ListItem(List=edges.Naked, Index=0, Wrap=True)
item_12 = ListItem(List=edges_2.Naked, Index=0, Wrap=True)
item_13 = ListItem(List=edges.Naked, Index=1, Wrap=True)
item_14 = ListItem(List=edges_2.Naked, Index=1, Wrap=True)
eval_6 = Evaluate(F=expression_6, x=split_2.ListA, y=num)
eval_7 = Evaluate(F=expression_7, x=split_2.ListB, y=num)
ccx = CurveCurve(CurveA=line_2, CurveB=item_13)  # -> Points, ParamsA, ParamsB
ccx_2 = CurveCurve(CurveA=line_2, CurveB=item_11)  # -> Points, ParamsA, ParamsB
ccx_3 = CurveCurve(CurveA=line_3, CurveB=item_14)  # -> Points, ParamsA, ParamsB
ccx_4 = CurveCurve(CurveA=line_3, CurveB=item_12)  # -> Points, ParamsA, ParamsB
merge = Merge(Data1=eval_6, Data2=eval_7)
rotate_3 = Rotate(Geometry=ccx_2.Points, Angle=merge, Plane=planar_3.Plane)  # -> Geometry, Transform
rotate_4 = Rotate(Geometry=ccx.Points, Angle=merge, Plane=planar_3.Plane)  # -> Geometry, Transform
rotate_5 = Rotate(Geometry=ccx_4.Points, Angle=eval_5, Plane=planar_4.Plane)  # -> Geometry, Transform
rotate_6 = Rotate(Geometry=ccx_3.Points, Angle=eval_5, Plane=planar_4.Plane)  # -> Geometry, Transform
rotate_7 = Rotate(Geometry=rotate_5.Geometry, Angle=flip_3, Plane=planar_4.Plane)  # -> Geometry, Transform
rotate_8 = Rotate(Geometry=ccx_2.Points, Angle=eval_5, Plane=planar_3.Plane)  # -> Geometry, Transform
rotate_9 = Rotate(Geometry=ccx.Points, Angle=eval_5, Plane=planar_3.Plane)  # -> Geometry, Transform
rotate_10 = Rotate(Geometry=rotate_4.Geometry, Angle=flip_3, Plane=planar_3.Plane)  # -> Geometry, Transform
rotate_11 = Rotate(Geometry=rotate_3.Geometry, Angle=flip_3, Plane=planar_3.Plane)  # -> Geometry, Transform
rotate_12 = Rotate(Geometry=rotate_6.Geometry, Angle=flip_3, Plane=planar_4.Plane)  # -> Geometry, Transform
ln_3 = Line(StartPoint=rotate_8.Geometry, EndPoint=rotate_9.Geometry)
ln_4 = Line(StartPoint=rotate_7.Geometry, EndPoint=rotate_12.Geometry)
ln_5 = Line(StartPoint=rotate_11.Geometry, EndPoint=rotate_10.Geometry)
ln_6 = Line(StartPoint=rotate_7.Geometry, EndPoint=rotate_11.Geometry)
ln_7 = Line(StartPoint=rotate_12.Geometry, EndPoint=rotate_10.Geometry)
item_15 = ListItem(List=debrep.Faces, Index=3, Wrap=True)
item_16 = ListItem(List=debrep.Faces, Index=2, Wrap=True)
len_2 = Length(Curve=ln_6)
pull = PullCurve(Curve=ln_7, Surface=item_15)
pull_2 = PullCurve(Curve=ln_6, Surface=item_16)
flatten = FlattenTree(Tree=len_2, Path="{0}")
ma = MassAddition(Input=flatten)  # -> Result, PartialResults
panel_5 = Panel(ma.Result)
edgesrf = EdgeSurface(CurveA=pull_2, CurveB=pull, CurveC=ln_4, CurveD=ln_5)
item_17 = ListItem(List=edgesrf, Index="20", Wrap=True)

panel_6 = Panel("Data Export")
edges_3 = BrepEdges(Brep=flow)  # -> Naked, Interior, NonManifold
edges_4 = BrepEdges(Brep=edgesrf)  # -> Naked, Interior, NonManifold
merge_2 = Merge(Data1=flow, Data2=edgesrf)
merge_3 = Merge(Data1=edges_3.Interior, Data2=edges_4.Naked, Data3=merge_2)
send = Send(
    Stream=panel,
    Data=merge_3,
    AutoSend=True,
    BaseId="e2d3ca478392b34ea733598b57ad5002",
    CurrentComponentState="up_to_date",
    KitName="Objects",
    OutputWrappers="https://app.speckle.systems\tb74089b7cc\t3ba607a8c9",
    UseDefaultCache=True,
    selectedKitName="Objects")

expression_8 = Expression(Expression="Format(\"x+y\", x,y)")
panel_7 = Panel("Property Calculation")
expression_9 = Expression(Expression="Format(\"x+y/2\", x,y)")
eval_8 = Evaluate(E=expression_8, x=num_3, y=num_5)
expression_10 = Expression(Expression="Format(\"pi*2*x*(y+1)\", x, y)")
expression_11 = Expression(Expression="Format(\"pi*2*x\", x, y)")
eval_9 = Evaluate(E=expression_9, x=num_3, y=num_5)
eval_10 = Evaluate(E=expression_10, x=eval_9, y=num_2)
eval_11 = Evaluate(E=expression_11, x=eval_9, y=eval_9)
expression_12 = Expression(Expression="Format(\"pi*x^2-pi*y^2\", x, y)")
expression_13 = Expression(Expression="Format(\"Round((x/y) + 0.5)\", x, y)")
volume = Volume(Geometry=flow)  # -> Volume, Centroid
join = BrepJoin(Breps=flow)  # -> Breps, Closed
ma_2 = MassAddition(Input=flatten(volume.Volume))  # -> Result, PartialResults
expression_14 = Expression(Expression="Format(\"x*y\", x, y)")
len_3 = Length(Curve=crv)
expression_15 = Expression(Expression="Format(\"x*y\", x, y)")
debrep_2 = DeconstructBrep(Brep=join.Breps)  # -> Faces, Edges, Vertices
panel_8 = Panel(ma_2.Result)
expression_16 = Expression(Expression="Format(\"x*y\", x, y)")
eval_12 = Evaluate(E=expression_12, x=eval_8, y=num_3)
eval_13 = Evaluate(E=expression_13, x=len_3, y=num_4)
expression_17 = Expression(Expression="Format(\"x%2\", x, y)")
planar_5 = IsPlanar(Surface=debrep_2.Faces, Interior=True)  # -> Planar, Plane
dispatch = Dispatch(List=debrep_2.Faces, DispatchPattern=planar_5.Planar)  # -> ListA, ListB
expression_18 = Expression(Expression="Format(\"x*(y-1)\", x, y)")
expression_19 = Expression(Expression="Format(\"x+y\", x, y)")
eval_14 = Evaluate(E=expression_15, x=num_2, y=eval_13)
eval_15 = Evaluate(E=expression_14, x=eval_13, y=eval_11)
series_3 = Series(Start="2", Step="1", Count=dispatch.ListB)
eval_16 = Evaluate(E=expression_16, x=eval_12, y=eval_10)
eval_17 = Evaluate(E=expression_17, x=series_3)
eval_18 = Evaluate(E=expression_18, x=num_2, y=eval_13)
dispatch_2 = Dispatch(List=dispatch.ListB, DispatchPattern=eval_17)  # -> ListA, ListB
sunion = SolidUnion(Breps=dispatch_2.ListA)
eval_19 = Evaluate(E=expression_19, x=eval_15, y=ma.Result)
cap = CapHoles(Brep=sunion)
volume_2 = Volume(Geometry=cap)  # -> Volume, Centroid

volume_3 = Volume(Geometry=cap)  # -> Volume, Centroid
concat_3 = Concatenate(FragmentA=panel_2, FragmentB="\test1.txt")

ma_3 = MassAddition(Input=flatten(volume_3.Volume))  # -> Result, PartialResults
merge_4 = Merge(Data1=ma_3.Result, Data2=ma_2.Result, Data3=eval_16, Data4=eval_8, Data5=eval_14, Data6=eval_18, Data7=eval_19)
flatten_2 = FlattenTree(Tree=merge_4, Path="{0}")
join_2 = TextJoin(Text=flatten_2, Join=",")
pcexporttxt = ExportTXT(
    Content=join_2,
    FileLocation=concat_3,
    Overwrite="true",
    Encoding="utf-8",
    Export="true",
    LastSaveLocalization="neutral,N")
